# Grasshopper definition disco.gh (Grasshopper 1.0.8)
# plug-ins: Hops

# ----
# Default hops values/
# useful for testing
number_slider = Slider(53, range=0..100)

# ----
# Inputs
radius = GetInteger(number_slider, AtLeast=1, AtMost=1, Maximum=2147483647, Minimum=-2147483648, TreeAccess=False)
divisionsvert = GetInteger(Slider(25, range=0..100), AtLeast=1, AtMost=1, Maximum=2147483647, Minimum=-2147483648, TreeAccess=False)
horzdivisionwidth = GetInteger(Slider(8, range=0..10), AtLeast=1, AtMost=1, Maximum=2147483647, Minimum=-2147483648, TreeAccess=False)
makespikey = GetBoolean(Toggle(False), AtLeast=1, AtMost=1, FalseValue="False", TreeAccess=False, TrueValue="True")

# ---- group: Inner Sphere
# Disco Ball Example
# Grasshoppper on the Web
# AECtech 2024
# Copyright: 2024 CORE studio | Thornton Tomasetti, Kohn Pedersen Fox Associates PC
# Contact: CORE@ThorntonTomasetti.com, info@kpf.com
# Website: https://www.aectech.us/
# Add User Data
number_slider_2 = Slider(1, range=0..1)
subtraction = Subtraction(A=radius, B=number_slider_2)
sph = Sphere(Base=PlaneXY(0, 0, 0), Radius=subtraction)
jagged = SettingsSpeed()
mesh = MeshBrep(Brep=sph, Settings=jagged)

uservalue = Text("sphere")
userkey = Text("name")
c_script = CSharpScript(geometry=mesh, userKey=userkey, userValue=uservalue)  # -> out, geoWithUserString; inputs geometry: GeometryBase, userKey: String, userValue: String
# ---------- c_script: C# ----------
    geometry.SetUserString(userKey, userValue);
   geoWithUserString = geometry;
# ---------- end c_script ----------

# ----
hops = Hops(
    CacheResultsInMemory=True,
    CacheSolveResults=True,
    RemoteSolveVersion=(0, 1, 0),
    ShowInput_Enabled=False,
    ShowInput_Path=False,
    SynchronousSolve=True)
u_text = UserText(Content=mesh, Keys=userkey, Values=uservalue, UserTextMode=1)  # -> Content, Keys, Values

# ---- group: Subdivide Sphere
# Make Spikey
sph_2 = Sphere(Base=PlaneXY(0, 0, 0), Radius=radius)
sdivide = DivideSurface(Surface=sph_2, UCount=divisionsvert, VCount=divisionsvert)  # -> Points, Normals, Parameters
flip = FlipMatrix(Data=sdivide.Points)
intcrv = Interpolate(Vertices=flip, Degree=3, Periodic=False, KnotStyle=1)  # -> flatten(Curve), Length, Domain
shift = ShiftList(List=intcrv.Curve, Shift=1, Wrap=False)
shift_2 = ShiftList(List=intcrv.Curve, Shift=-1, Wrap=False)
rulesrf = RuledSurface(CurveA=shift, CurveB=shift_2)
len = Length(Curve=intcrv.Curve)
division = Division(A=len, B=horzdivisionwidth)
divide = DivideDomain²(Domain=rulesrf, UCount=division, VCount=Slider(1, range=0..1))
subsrf = Isotrim(Surface=graft(rulesrf), Domain=divide)
debrep = DeconstructBrep(Brep=subsrf)  # -> Faces, Edges, Vertices
item = ListItem(List=debrep.Vertices, Index=0, Wrap=True)  # -> Item, Item1, Item2, Item3
srf4pt = _4PointSurface(CornerA=item.Item, CornerB=item.Item1, CornerC=item.Item2, CornerD=item.Item3)
neg = Negative(Value=Slider(0.1, range=0..0.1))
offset = OffsetCurve(Curve=srf4pt, Distance=neg, Corners=1)
clean = CleanTree(RemoveNulls=True, RemoveInvalid=True, RemoveEmpty=invert(False), Tree=offset)
flip_2 = Flip(Surface=clean)  # -> Surface, Result
yz = YZPlane(Origin=Point(0, 0, 0))

area = Area(Geometry=clean)  # -> Area, Centroid
smesh = SimpleMesh(Brep=flip_2.Surface)
facen = FaceNormals(Mesh=smesh)  # -> Centers, Normals
multiplication = Multiplication(A=facen.Normals, B=Slider(2, range=0..10))
move = Move(Geometry=area.Centroid, Motion=multiplication)  # -> Geometry, Transform
extr = ExtrudePoint(Base=clean, Point=move.Geometry)

filter = StreamFilter(Gate=makespikey, Stream0=flip_2.Surface, Stream1=extr)
smesh_2 = SimpleMesh(Brep=filter)
rotate = Rotate(Geometry=smesh_2, Angle="-0.5*pi", Plane=yz)  # -> Geometry, Transform

# ----
# Outputs
context_bake = ContextBake(Geometry=u_text.Content)
context_bake_2 = ContextBake(Geometry=rotate.Geometry)
